# Grasshopper definition MinBoundBox3d.ghx (Grasshopper 1.0.7)
# plug-ins: Grasshopper-ARCHICAD Live Connection built for Rhinoceros 7

panel = Panel("C:\Users\jozsef.szilagyi\Desktop\fejlesztések\GH\Release\GrashopperPythonScripts\MinBoundBox3d.py")
epsilon = Slider(0.0001, range=0.0001..1)
stepvolume = Slider(3, range=2..20)
stepplanar = Slider(3, range=2..20)
stepdivider = Slider(3, range=2..10)
imaxiteration = Slider(1000000, range=1..1000000)
dodrawiterationboxes = BooleanToggle(False)
roof = Roof(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)
deconstruct_roof = DeconstructRoof(
    RoofSinglePlane=roof,
    SurfaceType0_SurfaceType=(1, 0, 0),
    SurfaceType1_SurfaceType=(1, 0, 0),
    SurfaceType2_SurfaceType=(1, 0, 0),
    SurfaceType3_SurfaceType=(1, 0, 0),
    SurfaceType4_SurfaceType=(1, 0, 0),
    SurfaceType5_SurfaceType=(1, 0, 0),
    SurfaceType6_SurfaceType=(1, 0, 0),
    SurfaceType7_SurfaceType=(1, 0, 0),
    SurfaceType8_SurfaceType=(1, 0, 0),
    SurfaceType9_SurfaceType=(1, 0, 0),
    SurfaceType10_SurfaceType=(1, 0, 0),
    SurfaceType11_SurfaceType=(1, 0, 0),
    SurfaceType12_SurfaceType=(1, 0, 0),
    SurfaceType13_SurfaceType=(1, 0, 0),
    SurfaceType14_SurfaceType=(1, 0, 0),
    SurfaceType15_SurfaceType=(1, 0, 0),
    SurfaceType16_SurfaceType=(1, 0, 0),
    SurfaceType17_SurfaceType=(1, 0, 0))  # -> Polygon, flatten(Brep), RoofSettings
integer = Integer(stepvolume)
integer_2 = Integer(stepplanar)
integer_3 = Integer(stepdivider)
test = BooleanToggle(True)
file_path = FilePath(panel)
mesh = Mesh(deconstruct_roof.Brep)
geometry = Geometry(mesh)
path_mapper = PathMapper(geometry, source="{A}", target="{0}")
minimum_bounding_box = GhPythonScript(
    Code=file_path,
    IsTest=test,
    Selection=path_mapper,
    Epsilon=1e-06,
    IsBoundaryOpt=Toggle(False),
    IStepVolume=integer,
    IStepPlanar=integer_2,
    IStepDivider=integer_3,
    IMaxIteration=imaxiteration,
    DoDrawIterationBoxes=dodrawiterationboxes)  # -> Out, Result
panel_2 = Panel(geometry)
panel_3 = Panel(minimum_bounding_box.Result)
panel_4 = Panel(minimum_bounding_box.Out)
volume = Volume(Geometry=minimum_bounding_box.Result)  # -> Volume, Centroid
panel_5 = Panel(volume.Volume)
