# Grasshopper definition Zsaluzás.ghx (Grasshopper 1.0.7)
# plug-ins: LunchBox, Grasshopper-ARCHICAD Live Connection built for Rhinoceros 6

check_validity = Button()
slab = Slab([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])
beam = Beam([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])
wall = Wall([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])
column = Column([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])
roof = Roof()
deconstruct_wall = DeconstructWall(
    Wall=wall,
    SurfaceType0_SurfaceType=(1, 0, 0),
    SurfaceType1_ParamName="Reference Side Surfaces",
    SurfaceType1_SurfaceType=(1, 0, 0),
    SurfaceType2_SurfaceType=(1, 0, 0),
    SurfaceType3_SurfaceType=(1, 0, 0),
    SurfaceType4_SurfaceType=(1, 0, 0),
    SurfaceType5_SurfaceType=(1, 0, 0),
    SurfaceType6_SurfaceType=(1, 0, 0),
    SurfaceType7_SurfaceType=(1, 0, 0),
    SurfaceType8_SurfaceType=(1, 0, 0),
    SurfaceType9_SurfaceType=(1, 0, 0),
    SurfaceType10_ParamName="Wall Opening Side Surfaces",
    SurfaceType10_SurfaceType=(1, 0, 0),
    SurfaceType11_SurfaceType=(1, 0, 0))  # -> Curve, Brep, WallSettings, ReferenceSideSurfaces, flatten(WallOpeningSideSurfaces)
deconstruct_roof = DeconstructRoof(
    RoofSinglePlane=roof,
    SurfaceType0_SurfaceType=(1, 0, 0),
    SurfaceType1_SurfaceType=(1, 0, 0),
    SurfaceType2_SurfaceType=(1, 0, 0),
    SurfaceType3_SurfaceType=(1, 0, 0),
    SurfaceType4_SurfaceType=(1, 0, 0),
    SurfaceType5_SurfaceType=(1, 0, 0),
    SurfaceType6_SurfaceType=(1, 0, 0),
    SurfaceType7_SurfaceType=(1, 0, 0),
    SurfaceType8_SurfaceType=(1, 0, 0),
    SurfaceType9_SurfaceType=(1, 0, 0),
    SurfaceType10_SurfaceType=(1, 0, 0),
    SurfaceType11_SurfaceType=(1, 0, 0),
    SurfaceType12_SurfaceType=(1, 0, 0),
    SurfaceType13_SurfaceType=(1, 0, 0),
    SurfaceType14_SurfaceType=(1, 0, 0),
    SurfaceType15_SurfaceType=(1, 0, 0),
    SurfaceType16_SurfaceType=(1, 0, 0),
    SurfaceType17_SurfaceType=(1, 0, 0))  # -> Polygon, Brep, RoofSettings
deconstruct_column = DeconstructColumn(
    Column=column,
    SurfaceType0_SurfaceType=(1, 0, 0),
    SurfaceType1_SurfaceType=(1, 0, 0),
    SurfaceType2_ParamName="Bottom Surfaces",
    SurfaceType2_SurfaceType=(1, 0, 0),
    SurfaceType3_SurfaceType=(1, 0, 0),
    SurfaceType4_SurfaceType=(1, 0, 0),
    SurfaceType5_SurfaceType=(1, 0, 0),
    SurfaceType6_SurfaceType=(1, 0, 0),
    SurfaceType7_SurfaceType=(1, 0, 0),
    SurfaceType8_SurfaceType=(1, 0, 0))  # -> AnchorPoint, EndPoint, simplify(Brep), ColumnSettings, BottomSurfaces
deconstruct_beam = DeconstructBeam(
    Beam=beam,
    SurfaceType0_SurfaceType=(1, 0, 0),
    SurfaceType1_SurfaceType=(1, 0, 0),
    SurfaceType2_SurfaceType=(1, 0, 0),
    SurfaceType3_SurfaceType=(1, 0, 0),
    SurfaceType4_SurfaceType=(1, 0, 0),
    SurfaceType5_ParamName="Bottom Surfaces",
    SurfaceType5_SurfaceType=(1, 0, 0),
    SurfaceType6_SurfaceType=(1, 0, 0),
    SurfaceType7_SurfaceType=(1, 0, 0),
    SurfaceType8_SurfaceType=(1, 0, 0),
    SurfaceType9_SurfaceType=(1, 0, 0))  # -> Curve, Brep, BeamSettings, BottomSurfaces
deconstruct_slab = DeconstructSlab(
    Slab=slab,
    SurfaceType0_SurfaceType=(1, 0, 0),
    SurfaceType1_ParamName="Top Surfaces",
    SurfaceType1_SurfaceType=(1, 0, 0),
    SurfaceType2_SurfaceType=(1, 0, 0),
    SurfaceType3_SurfaceType=(1, 0, 0),
    SurfaceType4_SurfaceType=(1, 0, 0),
    SurfaceType5_SurfaceType=(1, 0, 0))  # -> Polygon, Brep, SlabSettings, TopSurfaces
extract_slab_settings = ExtractSlabSettings(SlabSettings=deconstruct_slab.SlabSettings)  # -> Structure, BuildingMaterial, Composite, Thickness, degrees(EdgeAngle), ReferencePlane, Layer, HomeStory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
extract_wall_settings = ExtractWallSettings(WallSettings=deconstruct_wall.WallSettings)  # -> Structure, BuildingMaterial, Composite, Profile, Height, Thickness, ThicknessTrapezoid, degrees(OutsideSlantAngle)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
extract_beam_settings = ExtractBeamSettings(BeamSettings=deconstruct_beam.BeamSettings)  # -> Structure, BuildingMaterial, Profile, Height, Width, AxisOffset, degrees(ProfileRotation), Layer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
brep = Brep(deconstruct_roof.Brep)
extract_roof_settings = ExtractRoofSettings(RoofSettings=deconstruct_roof.RoofSettings)  # -> Structure, BuildingMaterial, Composite, Thickness, degrees(EdgeAngle), Layer, HomeStory, ID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
brep_edges = BrepEdges(Brep=deconstruct_beam.BottomSurfaces)  # -> simplify(Naked), Interior, NonManifold
brep_edges_2 = BrepEdges(Brep=deconstruct_slab.TopSurfaces)  # -> Naked, Interior, NonManifold
brep_edges_3 = BrepEdges(Brep=deconstruct_wall.ReferenceSideSurfaces)  # -> simplify(Naked), Interior, NonManifold
area = Area(Geometry=deconstruct_wall.WallOpeningSideSurfaces)  # -> flatten(Area), Centroid
boundary_surfaces = BoundarySurfaces(Edges=brep_edges.Naked)
boundary_surfaces_2 = BoundarySurfaces(Edges=brep_edges_2.Naked)
boundary_surfaces_3 = BoundarySurfaces(Edges=brep_edges_3.Naked)
negative = Negative(Value=extract_slab_settings.Thickness)
brep_join = BrepJoin(Breps=boundary_surfaces)  # -> Breps, Closed
brep_join_2 = BrepJoin(Breps=boundary_surfaces_2)  # -> Breps, Closed
brep_join_3 = BrepJoin(Breps=boundary_surfaces_3)  # -> Breps, Closed
number = Number(area.Area)
brep_edges_4 = BrepEdges(Brep=brep_join.Breps)  # -> Naked, Interior, NonManifold
brep_edges_5 = BrepEdges(Brep=brep_join_2.Breps)  # -> simplify(Naked), Interior, NonManifold
mass_addition = MassAddition(Input=number)  # -> Result, PartialResults
brep_edges_6 = BrepEdges(Brep=brep_join_3.Breps)  # -> Naked, Interior, NonManifold
unit_z = UnitZ(Factor=negative)
unit_z_2 = UnitZ(Factor=extract_beam_settings.Height)
boundary_surfaces_4 = BoundarySurfaces(Edges=brep_edges_4.Naked)
boundary_surfaces_5 = BoundarySurfaces(Edges=brep_edges_5.Naked)
boundary_surfaces_6 = BoundarySurfaces(Edges=brep_edges_6.Naked)
face_normals = FaceNormals(Mesh=boundary_surfaces_6)  # -> Centers, Normals
negative_2 = Negative(Value=extract_wall_settings.Thickness)
extrude = Extrude(Base=boundary_surfaces_5, Direction=unit_z)
extrude_2 = Extrude(Base=boundary_surfaces_4, Direction=unit_z_2)
amplitude = Amplitude(Vector=face_normals.Normals, Amplitude=negative_2)
sort_duplicate_breps = SortDuplicateBreps(Breps=extrude)  # -> UniqueBreps, Indices
sort_duplicate_breps_2 = SortDuplicateBreps(Breps=extrude_2)  # -> UniqueBreps, Indices
extrude_3 = Extrude(Base=boundary_surfaces_6, Direction=amplitude)
sort_duplicate_breps_3 = SortDuplicateBreps(Breps=extrude_3)  # -> simplify(UniqueBreps), Indices
# Slab
brep_2 = Brep(flatten(sort_duplicate_breps.UniqueBreps))
# Column
brep_3 = Brep(flatten(deconstruct_column.Brep))
# Beam
brep_4 = Brep(flatten(sort_duplicate_breps_2.UniqueBreps))
# Wall
brep_5 = Brep(flatten(sort_duplicate_breps_3.UniqueBreps))
path_mapper = PathMapper(brep_2, source="{A}(i)", target="{0}(i)")
path_mapper_2 = PathMapper(brep_4, source="{A}(i)", target="{1}(i)")
path_mapper_3 = PathMapper(brep_5, source="{A}(i)", target="{2}(i)")
path_mapper_4 = PathMapper(brep_3, source="{A}(i)", target="{3}(i)")
brep_6 = Brep([path_mapper_2, path_mapper, path_mapper_3, path_mapper_4])
solid_union = SolidUnion(Breps=flatten(brep_6))
deconstruct_brep = DeconstructBrep(Brep=brep_6)  # -> Faces, Edges, Vertices
deconstruct_brep_2 = DeconstructBrep(Brep=solid_union)  # -> Faces, Edges, Vertices
area_2 = Area(Geometry=deconstruct_brep_2.Faces)  # -> Area, Centroid
list_length = ListLength(List=area_2.Centroid)
insert_items = InsertItems(List=deconstruct_brep.Faces, Item=area_2.Centroid, Indices=0, Wrap=True)
split_list = SplitList(List=insert_items, Index=list_length)  # -> ListA, ListB
trim_tree = TrimTree(Tree=split_list.ListA, Depth=2)
surface_closest_point = SurfaceClosestPoint(Point=trim_tree, Surface=graft(deconstruct_brep.Faces))  # -> Point, UVPoint, Distance
smaller_than = SmallerThan(FirstNumber=surface_closest_point.Distance, SecondNumber=0.1)  # -> SmallerThan, OrEqualTo
data = Data(flatten(smaller_than.SmallerThan))
cull_pattern = CullPattern(List=deconstruct_brep_2.Faces, CullPattern=smaller_than.SmallerThan)
sort_list = SortList(Keys=data)  # -> Keys, ValuesValuesA
path_mapper_5 = PathMapper(cull_pattern, source="{A;B;C}(i)", target="{A;B}(C)")
mass_addition_2 = MassAddition(Input=sort_list.Keys)  # -> Result, PartialResults
equality = Equality(FirstNumber=list_length, SecondNumber=mass_addition_2.Result)  # -> Equality, Inequality
brep_7 = Brep(path_mapper_5)
list_length_2 = ListLength(List=path_mapper)
null_item = NullItem(Item=brep_7)  # -> NullFlags, InvalidFlags, Description
boolean = Boolean(equality.Equality)
series = Series(Start=0, Step=1, Count=list_length_2)
gate_not = GateNot(A=null_item.NullFlags)
panel = Panel(boolean)
integer = Integer(255)
gate_not_2 = GateNot(A=boolean)
cull_pattern_2 = CullPattern(List=brep_7, CullPattern=gate_not)
concatenate = Concatenate(Fragment_A="{0;", Fragment_B=series, A="}")
multiplication = Multiplication(A=integer, B=boolean)
multiplication_2 = Multiplication(A=integer, B=gate_not_2)
trim_tree_2 = TrimTree(Tree=brep_7, Depth=1)
area_3 = Area(Geometry=cull_pattern_2)  # -> Area, Centroid
average = Average(Input=area_2.Centroid)
bounding_box = BoundingBox(Content=flatten(brep_6), Plane=PlaneXY(0, 0, 0), UnionBox=True)  # -> Box, Box_2
tree_branch = TreeBranch(Tree=brep_7, Path=concatenate, MaintainPaths=True)
colour_rgb = ColourRGB(Alpha=255, Red=multiplication_2, Green=multiplication, Blue=0)
deconstruct_box = DeconstructBox(Box=bounding_box.Box)  # -> Plane, X, Y, Z
deconstruct = Deconstruct(Point=area_3.Centroid)  # -> XComponent, YComponent, ZComponent
null_item_2 = NullItem(Item=tree_branch)  # -> NullFlags, InvalidFlags, Description
deconstruct_2 = Deconstruct(Point=average)  # -> XComponent, YComponent, ZComponent
panel_2 = Panel("""{2}
{3}""")
number_2 = Number(deconstruct_box.Z)
tree_branch_2 = TreeBranch(Tree=trim_tree_2, Path=panel_2, MaintainPaths=True)
gate_not_3 = GateNot(A=null_item_2.NullFlags)
multiplication_3 = Multiplication(A=number_2, B=1.5)
sort_list_2 = SortList(Keys=deconstruct.ZComponent, ValuesValuesA=cull_pattern_2)  # -> Keys, ValuesValuesA
cull_pattern_3 = CullPattern(List=tree_branch, CullPattern=gate_not_3)
construct_point = ConstructPoint(XCoordinate=deconstruct_2.XComponent, YCoordinate=deconstruct_2.YComponent, ZCoordinate=multiplication_3)
construct_point_2 = ConstructPoint(XCoordinate=deconstruct_2.XComponent, YCoordinate=deconstruct_2.YComponent, ZCoordinate=multiplication_3)
multiplication_4 = Multiplication(A=check_validity, B=1200)
split_list_2 = SplitList(List=reverse(sort_list_2.ValuesValuesA), Index=1)  # -> ListA, simplify(ListB)
bounding_box_2 = BoundingBox(Content=cull_pattern_3, Plane=PlaneXY(0, 0, 0), UnionBox=True)  # -> Box, Box_2
cloud_display = CloudDisplay(Points=[construct_point_2, construct_point], Colours=colour_rgb, Size=multiplication_4, SpriteType=0)
volume = Volume(Geometry=flatten(bounding_box_2.Box))  # -> Volume, Centroid
deconstruct_3 = Deconstruct(Point=volume.Centroid)  # -> XComponent, YComponent, ZComponent
sort_list_3 = SortList(Keys=deconstruct_3.ZComponent, ValuesValuesA=series)  # -> Keys, ValuesValuesA
list_item = ListItem(List=sort_list_3.ValuesValuesA, Index=-1, Wrap=True)  # -> Item1, Item
concatenate_2 = Concatenate(Fragment_A="{0;", Fragment_B=list_item.Item, A="}")
concatenate_3 = Concatenate(Fragment_A="{0;", Fragment_B=list_item.Item1, A="}")
tree_branch_3 = TreeBranch(Tree=brep_7, Path=concatenate_2, MaintainPaths=True)
tree_branch_4 = TreeBranch(Tree=brep_7, Path=concatenate_3, MaintainPaths=True)
area_4 = Area(Geometry=tree_branch_3)  # -> Area, Centroid
area_5 = Area(Geometry=tree_branch_4)  # -> Area, Centroid
trim_tree_3 = TrimTree(Tree=split_list_2.ListB, Depth=1)
deconstruct_4 = Deconstruct(Point=area_4.Centroid)  # -> XComponent, YComponent, ZComponent
deconstruct_5 = Deconstruct(Point=area_5.Centroid)  # -> XComponent, YComponent, ZComponent
tree_branch_5 = TreeBranch(Tree=trim_tree_3, Path="{0}", MaintainPaths=True)
tree_branch_6 = TreeBranch(Tree=trim_tree_3, Path="{1}", MaintainPaths=True)
sort_list_4 = SortList(Keys=deconstruct_4.ZComponent, ValuesValuesA=tree_branch_3)  # -> Keys, ValuesValuesA
sort_list_5 = SortList(Keys=deconstruct_5.ZComponent, ValuesValuesA=tree_branch_4)  # -> Keys, ValuesValuesA
split_list_3 = SplitList(List=reverse(sort_list_4.ValuesValuesA), Index=1)  # -> ListA, simplify(ListB)
split_list_4 = SplitList(List=reverse(sort_list_5.ValuesValuesA), Index=1)  # -> ListA, simplify(ListB)
split_list_5 = SplitList(List=reverse(split_list_4.ListB), Index=1)  # -> ListA, simplify(ListB)
trim_tree_4 = TrimTree(Tree=split_list_5.ListB, Depth=3)
trim_tree_5 = TrimTree(Tree=split_list_3.ListB, Depth=2)
brep_8 = Brep(tree_branch_2)
brep_9 = Brep([trim_tree_5, trim_tree_4])
brep_10 = Brep(tree_branch_6)
relay = Relay([brep_9, brep_10, brep_8])
cullnull = CullNulls(item=relay)
explode_tree = ExplodeTree(Data=cullnull)  # -> Branch0, Branch1, Branch2, Branch3
area_6 = Area(Geometry=cullnull)  # -> Area, Centroid
create_material = CreateMaterial(Diffuse=RGB(0, 80, 122), Specular=RGB(255, 255, 255), Emission=RGB(0, 0, 0), Transparency=0, Shine=0)
create_material_2 = CreateMaterial(Diffuse=RGB(240, 156, 31), Specular=RGB(255, 255, 255), Emission=RGB(0, 0, 0), Transparency=0, Shine=0)
create_material_3 = CreateMaterial(Diffuse=RGB(125, 24, 24), Specular=RGB(255, 255, 255), Emission=RGB(0, 0, 0), Transparency=0, Shine=0)
create_material_4 = CreateMaterial(Diffuse=RGB(169, 184, 61), Specular=RGB(255, 255, 255), Emission=RGB(0, 0, 0), Transparency=0, Shine=0)
mass_addition_3 = MassAddition(Input=area_6.Area)  # -> Result, PartialResults
explode_tree_2 = ExplodeTree(Data=mass_addition_3.Result)  # -> Branch0, Branch1, Branch2, Branch3
custom_preview = CustomPreview(Geometry=explode_tree.Branch0, Material=create_material)
custom_preview_2 = CustomPreview(Geometry=explode_tree.Branch1, Material=create_material_2)
custom_preview_3 = CustomPreview(Geometry=explode_tree.Branch2, Material=create_material_3)
custom_preview_4 = CustomPreview(Geometry=explode_tree.Branch3, Material=create_material_4)
opening = Panel(mass_addition.Result)
slab_2 = Panel(explode_tree_2.Branch0)
beam_2 = Panel(explode_tree_2.Branch1)
column_2 = Panel(explode_tree_2.Branch3)
wall_2 = Panel(explode_tree_2.Branch2)

# ==== cluster CullNulls: Culls null items from a list
item = ClusterInput()
null_item = NullItem(Item=item)  # -> NullFlags, InvalidFlags, Description
gate_not = GateNot(A=null_item.NullFlags)
cull_pattern = CullPattern(List=item, CullPattern=gate_not)
list = ClusterOutput(cull_pattern)
